# Grasshopper definition 2_data.gh (Grasshopper 1.0.7)

number_slider = Slider(10, range=0..10)
# 2_data
# 
# how to manage data in Grasshopper
curve = Curve(<curve referenced from the Rhino model>)
divide_curve = DivideCurve(Curve=curve, Count=number_slider, Kinks=False)  # -> Points, Tangents, Parameters
merge = Merge(Data1=Slider(1, range=0..10), Data2=Slider(4, range=0..10))
merge_2 = Merge(Data1=Toggle(True), Data2=Toggle(False), Data3=Toggle(False), Data4=Toggle(False))
merge_3 = Merge(Data1=Toggle(True), Data2=Toggle(False))
cull_pattern = CullPattern(List=divide_curve.Points, CullPattern=merge_2)
cull_pattern_2 = CullPattern(List=divide_curve.Points, CullPattern=merge_3)
list_item = ListItem(List=divide_curve.Points, Index=merge, Wrap=True)
cull_index = CullIndex(List=divide_curve.Points, Indices=Slider(1, range=0..10), Wrap=True)
panel = Panel(list_item)
panel_2 = Panel(divide_curve.Points)
panel_3 = Panel(cull_index)
panel_4 = Panel(cull_pattern)
panel_5 = Panel(cull_pattern_2)
# O componente Shift List (Sets> List) muda os números do índice para cima ou para baixo. A entrada S do componente é o deslocamento de deslocamento, a entrada L é a lista a ser deslocada e a entrada W (Wrap) é um parâmetro booleano que declara se o deslocamento resultante deve ser anexado novamente. Os números negativos deslocam a lista para baixo e os números positivos para cima. Por exemplo, se o deslocamento de deslocamento (S) for definido como -3 e o contorno (W) for definido como verdadeiro, os índices originais da lista são deslocados 3 unidades em direção ao final da lista e a lista é anexada novamente, o que significa que os três índices inferiores 8, 9 e 10 tornam-se os índices 0, 1 e 2, respectivamente.
divide_curve_2 = DivideCurve(Curve=curve, Count=number_slider, Kinks=False)  # -> Points, Tangents, Parameters
# 2.1.5 Lista de Divisão / Comprimento da Lista
# 
# O componente Split List (Sets> List) divide uma única lista de entrada em um índice específico em duas listas A e I
divide_curve_3 = DivideCurve(Curve=curve, Count=number_slider, Kinks=False)  # -> Points, Tangents, Parameters
shift_list = ShiftList(List=divide_curve_2.Points, Shift=Slider(3, range=0..10), Wrap=Toggle(False))
shift_list_2 = ShiftList(List=divide_curve_2.Points, Shift=Slider(3, range=0..10), Wrap=Toggle(True))
split_list = SplitList(List=divide_curve_3.Points, Index=Slider(3, range=0..10))  # -> ListA, ListB
panel_8 = Panel(shift_list)
panel_9 = Panel(divide_curve_2.Points)
panel_10 = Panel(shift_list_2)
panel_11 = Panel(divide_curve_3.Points)
panel_12 = Panel(split_list.ListA)
panel_13 = Panel(split_list.ListB)
list_length = ListLength(List=panel_11)
list_length_2 = ListLength(List=panel_12)
list_length_3 = ListLength(List=panel_13)
panel_14 = Panel(list_length)
panel_15 = Panel(list_length_2)
panel_16 = Panel(list_length_3)
# 2,1.6 Lista Inversa
# 
# Freqüentemente, é útil inverter a ordem de uma lista de dados. Com referência ao exemplo anterior, queremos criar uma linha que conecte o "último ponto" na Curva 01 com o "primeiro ponto" na Curva 02. Além disso, essa regra deve funcionar mesmo se alterar o número de subdivisões através de a entrada N da curva de divisão.
# 2.2 Sequências numéricas
# 
# Os componentes Series, Repeat Data, Random e Range criam e manipulam sequências numéricas para criar listas que gerenciam a geometria.
# 
# página 89 - continuar
divide_curve_4 = DivideCurve(Curve=curve, Count=number_slider, Kinks=False)  # -> Points, Tangents, Parameters
panel_17 = Panel(divide_curve_4.Points)
reverse_list = ReverseList(List=divide_curve_4.Points)
panel_18 = Panel(reverse_list)
