# Grasshopper definition conexao_trelica.gh (Grasshopper 1.0.7)
# plug-ins: LunchBox

# Reference: https://www.youtube.com/watch?v=MgEpyiUO-T0
surface = Surface(<surface referenced from the Rhino model>)
number_slider = Slider(4, range=0..10)
space_truss_structure_1 = SpaceTrussStructure1(Surface=surface, UDivisions=number_slider, VDivisions=number_slider, TrussDepth=Slider(7.05, range=0..10))  # -> PrimaryLines, PrimaryLines_2, WebLines, StructureNodes
curve = Curve([space_truss_structure_1.PrimaryLines, space_truss_structure_1.PrimaryLines_2, space_truss_structure_1.WebLines])
number_slider_2 = Slider(2.5, range=0..10)
flip_curve = FlipCurve(Curve=curve)  # -> Curve, Flag
evaluate_length = EvaluateLength(Curve=flip_curve.Curve, Length=number_slider_2, Normalized=False)  # -> Point, Tangent, Parameter
evaluate_length_2 = EvaluateLength(Curve=curve, Length=number_slider_2, Normalized=False)  # -> Point, Tangent, Parameter
line = Line(StartPoint=evaluate_length.Point, EndPoint=evaluate_length_2.Point)
number_slider_3 = Slider(0.7, range=0.5..2)
perp_frame = PerpFrame(Curve=line, Parameter=Slider(0, range=0..100))
perp_frame_2 = PerpFrame(Curve=line, Parameter=Slider(1, range=1..100))
cone = Cone(Base=perp_frame, Radius=number_slider_3, Length=expr("-x", number_slider_2))  # -> Cone, Tip
sphere = Sphere(Base=space_truss_structure_1.StructureNodes, Radius=Slider(1, range=0..10))
cone_2 = Cone(Base=perp_frame_2, Radius=number_slider_3, Length=number_slider_2)  # -> Cone, Tip
pipe = Pipe(Curve=line, Radius=number_slider_3, Caps=0)
solid_difference = SolidDifference(BrepsA=cone.Cone, BrepsB=sphere)
solid_difference_2 = SolidDifference(BrepsA=cone_2.Cone, BrepsB=sphere)
