# Grasshopper definition parade_parametrizada.gh (Grasshopper 1.0.7)

panel = Panel("TIJOLO A VISTA 10x6x20 cm")

comprimento = Slider(20, range=0..100)
largura = Slider(10, range=0..10)
altura = Slider(6, range=0..10)
domain_box = DomainBox(Base=PlaneXY(0, 0, 0), X=comprimento, Y=largura, Z=altura)

comprimento_2 = Slider(20, range=0..100)
largura_2 = Slider(10, range=0..10)
altura_2 = Slider(6, range=0..10)
domain_box_2 = DomainBox(Base=PlaneXY(0, 0, 0), X=comprimento_2, Y=largura_2, Z=altura_2)

construct_point = ConstructPoint(XCoordinate=0, YCoordinate=0, ZCoordinate=0)
construct_point_2 = ConstructPoint(XCoordinate=0, YCoordinate="500", ZCoordinate=0)
unit_z = UnitZ(Factor="300")
line = Line(StartPoint=construct_point, EndPoint=construct_point_2)
extrude = Extrude(Base=line, Direction=unit_z)

comprimento_3 = Slider(20, range=0..100)
largura_3 = Slider(10, range=0..10)
altura_3 = Slider(6, range=0..10)
domain_box_3 = DomainBox(Base=PlaneXY(0, 0, 0), X=comprimento_3, Y=largura_3, Z=altura_3)

# ----
# Parede de teste
# 5 x 3 metros
panel_4 = Panel("300")
construct_point_3 = ConstructPoint(XCoordinate=0, YCoordinate=0, ZCoordinate=0)
construct_point_4 = ConstructPoint(XCoordinate=0, YCoordinate="500", ZCoordinate=0)
unit_z_2 = UnitZ(Factor=panel_4)
line_2 = Line(StartPoint=construct_point_3, EndPoint=construct_point_4)
extrude_2 = Extrude(Base=line_2, Direction=unit_z_2)

# ----
# https://www.archdaily.com.br/br/797614/16-detalhes-construtivos-de-aparelhamento-de-tijolos
# Unidade usada no Rhino -> cm (units)
# https://www.youtube.com/watch?v=stYu0Kfe3Ps
construct_point_5 = ConstructPoint(XCoordinate=0, YCoordinate=0, ZCoordinate=0)
construct_point_6 = ConstructPoint(XCoordinate=0, YCoordinate="500", ZCoordinate=0)

comprimento_4 = Slider(20, range=0..100)
largura_4 = Slider(10, range=0..10)
altura_4 = Slider(6, range=0..10)
domain_box_4 = DomainBox(Base=PlaneXY(0, 0, 0), X=comprimento_4, Y=largura_4, Z=altura_4)

construct_point_7 = ConstructPoint(XCoordinate=0, YCoordinate=0, ZCoordinate=0)
construct_point_8 = ConstructPoint(XCoordinate=0, YCoordinate="500", ZCoordinate=0)
unit_z_3 = UnitZ(Factor="300")
line_3 = Line(StartPoint=construct_point_7, EndPoint=construct_point_8)
extrude_3 = Extrude(Base=line_3, Direction=unit_z_3)

unit_z_4 = UnitZ(Factor="300")

comprimento_5 = Slider(20, range=0..100)
largura_5 = Slider(10, range=0..10)
altura_5 = Slider(6, range=0..10)
domain_box_5 = DomainBox(Base=PlaneXY(0, 0, 0), X=comprimento_5, Y=largura_5, Z=altura_5)

line_4 = Line(StartPoint=construct_point_5, EndPoint=construct_point_6)

construct_point_9 = ConstructPoint(XCoordinate=0, YCoordinate=0, ZCoordinate=0)
construct_point_10 = ConstructPoint(XCoordinate=0, YCoordinate="500", ZCoordinate=0)
unit_z_5 = UnitZ(Factor="300")
line_5 = Line(StartPoint=construct_point_9, EndPoint=construct_point_10)
extrude_4 = Extrude(Base=line_5, Direction=unit_z_5)

comprimento_6 = Slider(20, range=0..100)
largura_6 = Slider(10, range=0..10)
altura_6 = Slider(6, range=0..10)
domain_box_6 = DomainBox(Base=PlaneXY(0, 0, 0), X=comprimento_6, Y=largura_6, Z=altura_6)

construct_point_11 = ConstructPoint(XCoordinate=0, YCoordinate=0, ZCoordinate=0)
construct_point_12 = ConstructPoint(XCoordinate=0, YCoordinate="500", ZCoordinate=0)
unit_z_6 = UnitZ(Factor="300")
line_6 = Line(StartPoint=construct_point_11, EndPoint=construct_point_12)
extrude_5 = Extrude(Base=line_6, Direction=unit_z_6)

extrude_6 = Extrude(Base=line_4, Direction=unit_z_4)
box = Box(domain_box)
# parede junta-prumo
unit_z_7 = UnitZ(Factor=1)

# ---- group: altura
integer = Integer(altura)

# ---- group: tijolo em pé
xy_plane = XYPlane(Origin=Point(0, 0, 0))
rotate = Rotate(Geometry=domain_box_4, Angle=1.570796327, Plane=xy_plane)  # -> Geometry, Transform

# ---- group: altura
integer_2 = Integer(altura_6)

# ---- group: comprimento
integer_3 = Integer(comprimento_6)

# ----
box_2 = Box(domain_box_2)

# ---- group: altura
integer_4 = Integer(altura_2)

# ----
unit_z_8 = UnitZ(Factor=1)
surface = Surface(extrude)
# parede cobogó
unit_z_9 = UnitZ(Factor=1)
xz_plane = XZPlane(Origin=Point(0, 0, 0))
surface_2 = Surface(extrude_6)
box_3 = Box(domain_box_3)

# ---- group: tijolo em pé
xy_plane_2 = XYPlane(Origin=Point(0, 0, 0))
rotate_2 = Rotate(Geometry=domain_box_5, Angle=1.570796327, Plane=xy_plane_2)  # -> Geometry, Transform

# ---- group: altura
integer_5 = Integer(altura_3)

# ----
subtraction = Subtraction(A=integer_3, B=integer_2)

# ---- group: tijolo em pé
xz_plane_2 = XZPlane(Origin=Point(0, 0, 0))
rotate_3 = Rotate(Geometry=domain_box_6, Angle=1.570796327, Plane=xz_plane_2)  # -> Geometry, Transform

# ----
surface_3 = Surface(extrude_2)
# A distância desconsidera argamassa, então recebe a mesma altura do tijolo
contour = Contour(Shape=surface_2, Point=Point(0, 0, 0), Direction=unit_z_7, Distance=integer_4)  # -> flatten(Contours)

# ---- group: A parade dividida pelo tijolo
comprimento_parede = Panel("500")
comprimento_tijolo = Panel(comprimento_2)
division = Division(A=comprimento_parede, B=comprimento_tijolo)
panel_8 = Panel(division)

# ----
# parede cobogó
unit_z_10 = UnitZ(Factor=1)
# A distância desconsidera argamassa, então recebe a mesma altura do tijolo
contour_2 = Contour(Shape=surface, Point=Point(0, 0, 0), Direction=unit_z_8, Distance=integer)  # -> flatten(Contours)

# ---- group: parede / tijolo * 2
comprimento_parede_2 = Panel("500")
comprimento_tijolo_2 = Panel(comprimento)
division_2 = Division(A=comprimento_parede_2, B=comprimento_tijolo_2)
multiplication = Multiplication(A=division_2, B="2")
panel_9 = Panel(multiplication)
panel_10 = Panel(division_2)

# ----
box_4 = Box(domain_box_4)
rotate_4 = Rotate(Geometry=rotate_2.Geometry, Angle=1.570796327, Plane=xz_plane)  # -> Geometry, Transform
# A distância desconsidera argamassa, então recebe a mesma altura do tijolo
contour_3 = Contour(Shape=surface_3, Point=Point(0, 0, 0), Direction=unit_z_9, Distance=integer_5)  # -> flatten(Contours)

# ---- group: parede / tijlo + (parede / tijolo * 35%)
comprimento_parede_3 = Panel("500")
comprimento_tijolo_3 = Panel(comprimento_3)
division_3 = Division(A=comprimento_parede_3, B=comprimento_tijolo_3)
multiplication_2 = Multiplication(A=division_3, B="1.35")
panel_11 = Panel(multiplication_2)
panel_12 = Panel(division_3)

# ----
# parede cobogó
unit_z_11 = UnitZ(Factor=1)
surface_4 = Surface(extrude_3)
box_5 = Box(domain_box_5)
deconstruct_brep = DeconstructBrep(Brep=box)  # -> Faces, Edges, Vertices
unit_z_12 = UnitZ(Factor=1)
deconstruct_brep_2 = DeconstructBrep(Brep=box_2)  # -> Faces, Edges, Vertices
box_6 = Box(domain_box_6)
# Separa as linhas impares das pares.
# 
# Fiadas impares e fiadas pares
dispatch = Dispatch(List=contour, DispatchPattern=[True, False])  # -> ListA, ListB
# A distância desconsidera argamassa, então recebe a mesma altura do tijolo
contour_4 = Contour(Shape=surface_4, Point=Point(0, 0, 0), Direction=unit_z_10, Distance=altura_4)  # -> flatten(Contours)
surface_5 = Surface(extrude_4)

# ---- group: parede / tijlo
comprimento_parede_4 = Panel("500")
comprimento_tijolo_4 = Panel(comprimento_4)
division_4 = Division(A=comprimento_parede_4, B=comprimento_tijolo_4)
panel_13 = Panel(division_4)

# ----
# Separa as linhas impares das pares.
# 
# Fiadas impares e fiadas pares
dispatch_2 = Dispatch(List=contour_2, DispatchPattern=[True, False])  # -> ListA, ListB
deconstruct_brep_3 = DeconstructBrep(Brep=box_3)  # -> Faces, Edges, Vertices
surface_6 = Surface(extrude_5)
# Separa as linhas impares das pares.
# 
# Fiadas impares e fiadas pares
dispatch_3 = Dispatch(List=contour_3, DispatchPattern=[True, False])  # -> ListA, ListB
# A distância desconsidera argamassa, então recebe a mesma altura do tijolo
contour_5 = Contour(Shape=surface_5, Point=Point(0, 0, 0), Direction=unit_z_11, Distance="8")  # -> flatten(Contours)

# ---- group: parede / tijlo
comprimento_parede_5 = Panel("500")
comprimento_tijolo_5 = Panel(comprimento_5)
division_5 = Division(A=comprimento_parede_5, B=comprimento_tijolo_5)
panel_14 = Panel(division_5)

# ----
division_6 = Division(A=altura_6, B="2")
# A distância desconsidera argamassa, então recebe a mesma altura do tijolo
contour_6 = Contour(Shape=surface_6, Point=Point(0, 0, 0), Direction=unit_z_12, Distance="13")  # -> flatten(Contours)

# ---- group: parede / tijlo
comprimento_parede_6 = Panel("500")
comprimento_tijolo_6 = Panel(comprimento_6)
division_7 = Division(A=comprimento_parede_6, B=comprimento_tijolo_6)
panel_15 = Panel(division_7)

# ----
# Separa as linhas impares das pares.
# 
# Fiadas impares e fiadas pares
number_slider = Slider(4, range=0..10)
list_item = ListItem(List=deconstruct_brep.Faces, Index=Slider(4, range=0..10), Wrap=True)
curve = Curve(dispatch.ListA)
curve_2 = Curve(dispatch.ListB)
list_item_2 = ListItem(List=deconstruct_brep_2.Faces, Index=Slider(4, range=0..10), Wrap=True)
dispatch_4 = Dispatch(List=contour_4, DispatchPattern=[True, False])  # -> ListA, ListB
deconstruct_brep_4 = DeconstructBrep(Brep=box_4)  # -> Faces, Edges, Vertices
curve_3 = Curve(dispatch_2.ListA)
curve_4 = Curve(dispatch_2.ListB)
division_8 = Division(A=altura_5, B="2")
deconstruct_brep_5 = DeconstructBrep(Brep=rotate.Geometry)  # -> Faces, Edges, Vertices
negative = Negative(Value=division_6)
curve_5 = Curve(dispatch_3.ListA)
curve_6 = Curve(dispatch_3.ListB)
list_item_3 = ListItem(List=deconstruct_brep_3.Faces, Index=Slider(4, range=0..10), Wrap=True)
# Separa as linhas impares das pares.
# 
# Fiadas impares e fiadas pares
dispatch_5 = Dispatch(List=contour_5, DispatchPattern=[True, False])  # -> ListA, ListB
area = Area(Geometry=list_item)  # -> Area, Centroid
deconstruct_brep_6 = DeconstructBrep(Brep=box_5)  # -> Faces, Edges, Vertices
# Aqui os tijolos estariam alinhados (junta prumo)
horizontal_frames = HorizontalFrames(Curve=curve, Count=division)  # -> Frames, Parameters
horizontal_frames_2 = HorizontalFrames(Curve=curve_2, Count=division)  # -> Frames, Parameters
deconstruct_brep_7 = DeconstructBrep(Brep=rotate_4.Geometry)  # -> Faces, Edges, Vertices
deconstruct_brep_8 = DeconstructBrep(Brep=box_6)  # -> Faces, Edges, Vertices
area_2 = Area(Geometry=list_item_2)  # -> Area, Centroid
negative_2 = Negative(Value=division_8)
dispatch_6 = Dispatch(List=contour_6, DispatchPattern=[True, False])  # -> ListA, ListB
# Aqui os tijolos estariam alinhados (junta prumo)
horizontal_frames_3 = HorizontalFrames(Curve=curve_3, Count=multiplication)  # -> Frames, Parameters
horizontal_frames_4 = HorizontalFrames(Curve=curve_4, Count=multiplication)  # -> Frames, Parameters
area_3 = Area(Geometry=rotate_3.Geometry)  # -> Area, Centroid
# Separa as linhas impares das pares.
# 
# Fiadas impares e fiadas pares
unit_z_13 = UnitZ(Factor=negative)
multiplication_3 = Multiplication(A=division_4, B="2")
# Aqui os tijolos estariam alinhados (junta prumo)
horizontal_frames_5 = HorizontalFrames(Curve=curve_5, Count=multiplication_2)  # -> Frames, Parameters
horizontal_frames_6 = HorizontalFrames(Curve=curve_6, Count=multiplication_2)  # -> Frames, Parameters
curve_7 = Curve(dispatch_4.ListA)
curve_8 = Curve(dispatch_4.ListB)
area_4 = Area(Geometry=list_item_3)  # -> Area, Centroid
list_item_4 = ListItem(List=deconstruct_brep_4.Faces, Index=Slider(4, range=0..10), Wrap=True)
list_item_5 = ListItem(List=deconstruct_brep_5.Faces, Index=number_slider, Wrap=True)
unit_z_14 = UnitZ(Factor=negative_2)
point = Point(area.Centroid)
multiplication_4 = Multiplication(A=division_5, B="2")
curve_9 = Curve(dispatch_5.ListA)
curve_10 = Curve(dispatch_5.ListB)
point_2 = Point(area_2.Centroid)
area_5 = Area(Geometry=rotate_4.Geometry)  # -> Area, Centroid
move = Move(Geometry=area_3.Centroid, Motion=unit_z_13)  # -> Geometry, Transform
# Aqui os tijolos estariam alinhados (junta prumo)
horizontal_frames_7 = HorizontalFrames(Curve=curve_7, Count=multiplication_3)  # -> Frames, Parameters
dispatch_7 = Dispatch(List=horizontal_frames.Frames, DispatchPattern=[True, False])  # -> ListA, ListB
horizontal_frames_8 = HorizontalFrames(Curve=curve_8, Count=multiplication_3)  # -> Frames, Parameters
list_item_6 = ListItem(List=deconstruct_brep_6.Faces, Index=Slider(4, range=0..10), Wrap=True)
multiplication_5 = Multiplication(A=division_7, B="2")
dispatch_8 = Dispatch(List=horizontal_frames_2.Frames, DispatchPattern=[True, False])  # -> ListA, ListB
curve_11 = Curve(dispatch_6.ListA)
curve_12 = Curve(dispatch_6.ListB)
list_item_7 = ListItem(List=deconstruct_brep_8.Faces, Index=Slider(4, range=0..10), Wrap=True)
dispatch_9 = Dispatch(List=horizontal_frames_3.Frames, DispatchPattern=[True, False])  # -> ListA, ListB
dispatch_10 = Dispatch(List=horizontal_frames_4.Frames, DispatchPattern=[True, False])  # -> ListA, ListB
point_3 = Point(area_4.Centroid)
area_6 = Area(Geometry=list_item_4)  # -> Area, Centroid
area_7 = Area(Geometry=list_item_5)  # -> Area, Centroid
dispatch_11 = Dispatch(List=horizontal_frames_5.Frames, DispatchPattern=[True, False])  # -> ListA, ListB
dispatch_12 = Dispatch(List=horizontal_frames_6.Frames, DispatchPattern=[True, False])  # -> ListA, ListB
# Aqui os tijolos estariam alinhados (junta prumo)
horizontal_frames_9 = HorizontalFrames(Curve=curve_9, Count=multiplication_4)  # -> Frames, Parameters
horizontal_frames_10 = HorizontalFrames(Curve=curve_10, Count=multiplication_4)  # -> Frames, Parameters
panel_16 = Panel(area_3.Centroid)
panel_17 = Panel(move.Geometry)
move_2 = Move(Geometry=area_5.Centroid, Motion=unit_z_14)  # -> Geometry, Transform
area_8 = Area(Geometry=list_item_6)  # -> Area, Centroid
# Aqui os tijolos estariam alinhados (junta prumo)
horizontal_frames_11 = HorizontalFrames(Curve=curve_11, Count=multiplication_5)  # -> Frames, Parameters
horizontal_frames_12 = HorizontalFrames(Curve=curve_12, Count=multiplication_5)  # -> Frames, Parameters
area_9 = Area(Geometry=list_item_7)  # -> Area, Centroid

# ---- group: sem uso
dispatch_13 = Dispatch(List=horizontal_frames_8.Frames, DispatchPattern=[True, False])  # -> ListA, ListB
dispatch_14 = Dispatch(List=horizontal_frames_7.Frames, DispatchPattern=[True, False])  # -> ListA, ListB

# ----
point_4 = Point(area_6.Centroid)
point_5 = Point(area_7.Centroid)
plane = Plane(horizontal_frames_2.Frames)
# Aqui os tijolos ficam alternados (amarrados)
plane_2 = Plane(horizontal_frames.Frames)
plane_3 = Plane(dispatch_10.ListB)
# Aqui os tijolos ficam alternados (amarrados)
plane_4 = Plane(dispatch_9.ListA)

# ---- group: sem uso
dispatch_15 = Dispatch(List=horizontal_frames_10.Frames, DispatchPattern=[True, False])  # -> ListA, ListB
dispatch_16 = Dispatch(List=horizontal_frames_9.Frames, DispatchPattern=[True, False])  # -> ListA, ListB

# ----
point_6 = Point(area_8.Centroid)
plane_5 = Plane(dispatch_12.ListB)
# Aqui os tijolos ficam alternados (amarrados)
plane_6 = Plane(dispatch_11.ListA)
point_7 = Point(move_2.Geometry)
point_8 = Point(area_9.Centroid)
point_9 = Point(move.Geometry)

# ---- group: sem uso
dispatch_17 = Dispatch(List=horizontal_frames_12.Frames, DispatchPattern=[True, False])  # -> ListA, ListB
dispatch_18 = Dispatch(List=horizontal_frames_11.Frames, DispatchPattern=[True, False])  # -> ListA, ListB

# ----
plane_7 = Plane(dispatch_13.ListB)
# Aqui os tijolos ficam alternados (amarrados)
plane_8 = Plane(dispatch_14.ListA)
orient = Orient(Geometry=box_2, Source=point_2, Target=plane_2)  # -> Geometry, Transform
orient_2 = Orient(Geometry=box_2, Source=point_2, Target=plane)  # -> Geometry, Transform
plane_9 = Plane(dispatch_15.ListB)
# Aqui os tijolos ficam alternados (amarrados)
plane_10 = Plane(dispatch_16.ListA)
orient_3 = Orient(Geometry=box, Source=point, Target=plane_4)  # -> Geometry, Transform
orient_4 = Orient(Geometry=box, Source=point, Target=plane_3)  # -> Geometry, Transform
plane_11 = Plane(dispatch_17.ListB)
# Aqui os tijolos ficam alternados (amarrados)
plane_12 = Plane(dispatch_18.ListA)
orient_5 = Orient(Geometry=box_3, Source=point_3, Target=plane_6)  # -> Geometry, Transform
orient_6 = Orient(Geometry=box_3, Source=point_3, Target=plane_5)  # -> Geometry, Transform
orient_7 = Orient(Geometry=box_4, Source=point_4, Target=plane_8)  # -> Geometry, Transform
orient_8 = Orient(Geometry=rotate.Geometry, Source=point_5, Target=plane_7)  # -> Geometry, Transform
orient_9 = Orient(Geometry=box_5, Source=point_6, Target=plane_10)  # -> Geometry, Transform
orient_10 = Orient(Geometry=rotate_4.Geometry, Source=point_7, Target=plane_9)  # -> Geometry, Transform
orient_11 = Orient(Geometry=box_6, Source=point_8, Target=plane_12)  # -> Geometry, Transform
orient_12 = Orient(Geometry=rotate_3.Geometry, Source=point_9, Target=plane_11)  # -> Geometry, Transform

comprimento_7 = Slider(20, range=0..100)
largura_7 = Slider(10, range=0..10)
altura_7 = Slider(6, range=0..10)
domain_box_7 = DomainBox(Base=PlaneXY(0, 0, 0), X=comprimento_7, Y=largura_7, Z=altura_7)

construct_point_13 = ConstructPoint(XCoordinate=0, YCoordinate=0, ZCoordinate=0)
construct_point_14 = ConstructPoint(XCoordinate=0, YCoordinate="500", ZCoordinate=0)
ghpython_script = GhPythonScript()  # -> out, a
# ---------- ghpython_script: Python ----------
__author__ = "Renato"
__version__ = "2021.04.09"

import rhinoscriptsyntax as rs

x = 20
y = 10
z = 6

#(point, point, point ,point, point, point ,point,point)

#box = rs.AddBox(point, point, point ,point, point, point ,point,point)
# ---------- end ghpython_script ----------
unit_z_15 = UnitZ(Factor="300")
line_7 = Line(StartPoint=construct_point_13, EndPoint=construct_point_14)
extrude_7 = Extrude(Base=line_7, Direction=unit_z_15)
# parede junta-prumo
unit_z_16 = UnitZ(Factor=1)
box_7 = Box(domain_box_7)

# ---- group: altura
integer_6 = Integer(altura_7)

# ----
surface_7 = Surface(extrude_7)
# A distância desconsidera argamassa, então recebe a mesma altura do tijolo
contour_7 = Contour(Shape=surface_7, Point=Point(0, 0, 0), Direction=unit_z_16, Distance=integer_6)  # -> flatten(Contours)

# ---- group: A parade dividida pelo tijolo
comprimento_parede_7 = Panel("500")
comprimento_tijolo_7 = Panel(comprimento_7)
division_9 = Division(A=comprimento_parede_7, B=comprimento_tijolo_7)
panel_19 = Panel(division_9)

# ----
# receber surface -> explodir brep -> receber edge inferior -> copiar edge em listas pares/impares;
ghpython_script_2 = GhPythonScript(surface=surface_7)  # -> out, a; inputs surface: Surface
# ---------- ghpython_script_2: Python ----------
__author__ = "Renato"
__version__ = "2021.04.09"

import rhinoscriptsyntax as rs

a = surface


#https://developer.rhino3d.com/samples/rhinocommon/create-contour-curves/
# ---------- end ghpython_script_2 ----------
deconstruct_brep_9 = DeconstructBrep(Brep=ghpython_script_2.a)  # -> Faces, Edges, Vertices
deconstruct_brep_10 = DeconstructBrep(Brep=box_7)  # -> Faces, Edges, Vertices
# Separa as linhas impares das pares.
# 
# Fiadas impares e fiadas pares
dispatch_19 = Dispatch(List=contour_7, DispatchPattern=[True, False])  # -> ListA, ListB
list_item_8 = ListItem(List=deconstruct_brep_9.Edges, Index=Slider(3, range=0..10), Wrap=True)
ghpython_script_3 = GhPythonScript(x=list_item_8)  # -> out, a
# ---------- ghpython_script_3: Python ----------
__author__ = "Renato"
__version__ = "2021.04.12"

import rhinoscriptsyntax as rs

a = x

altura = 300

altura_tj = 6

pares = []
impares = []

cont = 0

"""
while cont <= 300:
    if cont == 0 or cont == par:
        pares.append(copia_a) #copia de linha
    else:
        impares.append(copia_a) #copia de linha 
    cont += altura_tj
"""
# ---------- end ghpython_script_3 ----------
curve_13 = Curve(dispatch_19.ListA)
curve_14 = Curve(dispatch_19.ListB)
list_item_9 = ListItem(List=deconstruct_brep_10.Faces, Index=Slider(4, range=0..10), Wrap=True)
# Aqui os tijolos estariam alinhados (junta prumo)
horizontal_frames_13 = HorizontalFrames(Curve=curve_13, Count=division_9)  # -> Frames, Parameters
horizontal_frames_14 = HorizontalFrames(Curve=curve_14, Count=division_9)  # -> Frames, Parameters
area_10 = Area(Geometry=list_item_9)  # -> Area, Centroid
integer_7 = Integer(contour_7)
point_10 = Point(area_10.Centroid)

# ---- group: classificando linhas
# Agora podemos dividir em números pares e impares.
# 
# Dispach
python = PythonScript(Curves=contour_7, Values=integer_7)  # -> SortedCurves; inputs Curves: list of Curve, Values: list
# ---------- python: Python ----------
"""
Use this method if the key to sort by is NOT a property of the data to sort.
"""

# Zip the two lists and sort them by the first entries i.e. the Values
sortedBoth = sorted(zip(Values,Curves))

# Extract just the sorted curves
SortedCurves = [l[1] for l in sortedBoth]
# ---------- end python ----------
eval = EvaluateCurve(Curve=reparameterize(python), Parameter=0.5)  # -> Point, Tangent, Angle
points = PointList(Points=eval.Point, Size=Slider(4, range=0..10))

# ----
dispatch_20 = Dispatch(List=horizontal_frames_13.Frames, DispatchPattern=[True, False])  # -> ListA, ListB
dispatch_21 = Dispatch(List=horizontal_frames_14.Frames, DispatchPattern=[True, False])  # -> ListA, ListB
plane_13 = Plane(horizontal_frames_14.Frames)
# Aqui os tijolos ficam alternados (amarrados)
plane_14 = Plane(horizontal_frames_13.Frames)
panel_20 = Panel(plane_14)
orient_13 = Orient(Geometry=box_7, Source=point_10, Target=plane_14)  # -> Geometry, Transform
orient_14 = Orient(Geometry=box_7, Source=point_10, Target=plane_13)  # -> Geometry, Transform

# ---- group: deve funcionar igual ao orient do grasshopper
ghpython_script_4 = GhPythonScript(object_id=box_7, reference=point_10, target=plane_14)  # -> out, a; inputs target: list
# ---------- ghpython_script_4: Python ----------
__author__ = "Renato"
__version__ = "2021.04.09"

import rhinoscriptsyntax as rs

#orient = rs.OrientObject(object_id, reference, target, flags=0)
# ---------- end ghpython_script_4 ----------
