# Grasshopper definition map_to_surface.gh (Grasshopper 1.0.7)

# ---- group: Grid
# aula_7_MAP_TO_SURFACE
# 
# https://www.youtube.com/watch?v=KGkK6oR2Kdc&list=PLwO_FSSNwNi7OFTWaNLeMP0-PVegS6dKV&index=10
number_slider = Slider(2, range=1..15)
number_slider_2 = Slider(11, range=1..15)
number_slider_3 = Slider(10, range=1..15)
hexgrid = Hexagonal(Plane=PlaneXY(0, 0, 0), Size=number_slider, ExtentX=number_slider_2, ExtentY=number_slider_3)  # -> simplify(graft(Cells)), Points

# ----
trigrid = Triangular(Plane=PlaneXY(0, 0, 0), Size=1, ExtentX=number_slider_2, ExtentY=number_slider_3)  # -> simplify(graft(Cells)), Points
number_slider_4 = Slider(60, range=0..100)
number_slider_5 = Slider(14, range=0..100)
number_slider_6 = Slider(35, range=0..100)
number_slider_7 = Slider(60, range=0..100)
area = Area(Geometry=trigrid.Cells)  # -> Area, Centroid
python = GhPythonScript(x=trigrid.Cells)  # -> out, a
# ---------- python: Python ----------
__author__ = "Renato"
__version__ = "2021.02.13"

import rhinoscriptsyntax as rs

print(x)
# ---------- end python ----------
scale = Scale(Geometry=trigrid.Cells, Center=area.Centroid, Factor=Slider(0.85, range=0..1))  # -> simplify(graft(Geometry)), Transform
multiplication = Multiplication(A=number_slider_4, B="2")
multiplication_2 = Multiplication(A=number_slider_7, B="2")
panel = Panel(python.out)
pt = ConstructPoint(XCoordinate=number_slider_4, YCoordinate=0, ZCoordinate=number_slider_5)
pt_2 = ConstructPoint(XCoordinate=multiplication, YCoordinate=0, ZCoordinate=number_slider_6)
pt_3 = ConstructPoint(XCoordinate=number_slider_7, YCoordinate=number_slider_7, ZCoordinate=number_slider_6)
pt_4 = ConstructPoint(XCoordinate=multiplication_2, YCoordinate=number_slider_7, ZCoordinate=number_slider_5)
crv = Curve([trigrid.Cells, scale.Geometry])
ln = Line(StartPoint=pt, EndPoint=pt_2)
ln_2 = Line(StartPoint=pt_3, EndPoint=pt_4)
# 0
# 1
panel_2 = Panel(trigrid.Cells)
# 2
# 0
# 1
panel_3 = Panel(scale.Geometry)
# 2
# 0
# 0
# 1
# 1
panel_4 = Panel(crv)

# ---- group: Surface
loft = Loft(Curves=[ln, ln_2], Options={Adjust=False, Closed=False, LoftEnds=0, LoftSimp=0, LoftType=0, Rebuild=10, Refit=0.01})

# ----
srf = Surface(loft)
bbox = BoundingBox(Content=flatten(trigrid.Cells), Plane=PlaneXY(0, 0, 0), UnionBox=True)  # -> Box, Box_2
panel_5 = Panel(bbox.Box)
map_srf = MapToSurface(Curve=crv, Source=bbox.Box, Target=srf)
loft_2 = Loft(Curves=map_srf, Options={Adjust=False, Closed=False, LoftEnds=0, LoftSimp=0, LoftType=0, Rebuild=10, Refit=0.01})
